# Dynamo graph UpgradeFiles.dyn (Dynamo 1.0.0.1180)

# group: RFA Upgrade
files_to_upgrade = Directory("..")
path_to_save_files = Directory("..")
upgrade_rfas = Python(IN[0]=files_to_upgrade, IN[1]=path_to_save_files)
# ---------- upgrade_rfas.python (41 lines) ----------
import sys
sys.path.append("C:\Program Files (x86)\IronPython 2.7\Lib");
import os
import clr

clr.AddReference('ProtoGeometry')
clr.AddReference('RevitNodes')
clr.AddReference('RevitServices')
import RevitServices
from RevitServices.Persistence import DocumentManager

from Autodesk.DesignScript.Geometry import *
#The inputs to this node will be stored as a list in the IN variables.
dataEnteringNode = IN
a=[]
r=[]
app = DocumentManager.Instance.CurrentUIApplication.Application

for file in os.listdir(IN[0]):
  if file.endswith(".rfa"):
  	a.append(file)
  	f = str(IN[0]) + "\\" + file
  	d = app.OpenDocumentFile(f)
  	newf = IN[1] + "\\" + file
  	d.SaveAs(newf)
  	d.Close()
  	r.append(newf)

#remove backups
for file in os.listdir(IN[1]):
  if file.endswith(".0001.rfa"):
    ftd = IN[1] + "\\" + file
    os.remove(ftd)

#test for success
res = False
if len(a) == len(r):
  res = True

#Assign your output to the OUT variable.
OUT = res
# ----------------------------------------
